# Grasshopper definition kangaroo_cloth.gh (Grasshopper 1.0.8)

width = Slider(50, range=5..100)
depth = Slider(50, range=5..100)
rectangle = Rectangle(Plane=PlaneXY(0, 0, 0), XSize=width, YSize=depth, Radius=0)  # -> Rectangle, Length
meshu = Slider(20, range=4..60)
meshv = Slider(20, range=4..60)
boundary = BoundarySurfaces(Edges=rectangle.Rectangle)
mesh_uv = MeshSurface(Surface=boundary, UCount=meshu, VCount=meshv, Overhang=True, Equalize=False)
one = Slider(1, range=1..2)
addition = Addition(A=meshu, B=one)
addition_2 = Addition(A=meshv, B=one)
multiplication = Multiplication(A=addition, B=meshv)
multiplication_2 = Multiplication(A=addition, B=addition_2)
subtraction = Subtraction(A=multiplication_2, B=one)
demesh = DeconstructMesh(Mesh=mesh_uv)  # -> Vertices, Faces, Colours, Normals
item = ListItem(List=demesh.Vertices, Index=0, Wrap=True)
item_2 = ListItem(List=demesh.Vertices, Index=meshu, Wrap=True)
item_3 = ListItem(List=demesh.Vertices, Index=multiplication, Wrap=True)
item_4 = ListItem(List=demesh.Vertices, Index=subtraction, Wrap=True)
medges = MeshEdges(Mesh=mesh_uv)  # -> NakedEdges, InteriorEdges, NonManifoldEdges
anchor = Anchor(Point=[item, item_2, item_3, item_4], Strength=10000)
gravity = Slider(-0.1, range=-5..0)
Z = UnitZ(Factor=gravity)
load = Load(Point=demesh.Vertices, ForceVector=Z, Weighting=1)
springlength = Slider(2.5, range=0.5..5)
springstrength = Slider(5, range=0.1..5)
length_line = LengthLine(Line=[medges.InteriorEdges, medges.NakedEdges], Length=springlength, Strength=springstrength)
solver = Solver(GoalObjects=[anchor, load, length_line], Reset=Toggle(False), Threshold=1e-15, Tolerance=0.0001, On=Toggle(True))  # -> I, V, O
conmesh = ConstructMesh(Vertices=solver.V, Faces=demesh.Faces)
